# Grasshopper definition 05_Nozzles.gh (Grasshopper 1.0.7)
# plug-ins: Salad Slicer

# ----
# License and author information
I = Info()
panel = Panel(I)

recnoz = RectangularNozzle(
    BoxWidth=Slider(70, range=0..100),
    BoxDept=Slider(50, range=0..100),
    FilletRadius=Slider(10, range=0..20),
    Length1=Slider(25, range=0..100),
    Length2=Slider(75, range=0..100),
    Length3=Slider(25, range=0..100),
    Length4=Slider(25, range=0..100),
    OuterDiameter=Slider(30, range=0..100),
    InnerDiameter=Slider(25, range=0..100),
    NozzleWidth=Slider(50, range=0..100),
    NozzleHeight=Slider(10, range=0..100),
    Divide=Toggle(True))
rounoz = RoundNozzle(
    Length1=Slider(25, range=0..100),
    Length2=Slider(100, range=0..100),
    Length3=Slider(25, range=0..100),
    OuterDiameter=Slider(41, range=0..100),
    InnerDiameter=Slider(35, range=0..100),
    NozzleDiameter=Slider(30, range=0..100),
    WallThickness=Slider(4, range=0..10),
    Gap=Slider(1, range=0..10))
X = UnitX(Factor=Slider(150, range=0..200))
preview = CustomPreview(Geometry=rounoz, Material=ColourSwatch(SwatchColor=RGB(168, 168, 168)))
move = Move(Geometry=recnoz, Motion=X)  # -> Geometry, Transform
preview_2 = CustomPreview(Geometry=move.Geometry, Material=ColourSwatch(SwatchColor=RGB(168, 168, 168)))
